# Grasshopper definition bunny.gh (Grasshopper 1.0.7)

construct_point = ConstructPoint(XCoordinate="0.00512203", YCoordinate="0.104572", ZCoordinate="0.0619309")
sphere = Sphere(Base=construct_point, Radius="0.005")
